test file "MainTest1"

suite "New Test Suite 1"

  case "Input Voltage Flag 1 to 0" [baseline]
    model test_TankSensing2, harness test_TankSensing2_Harness5
    parameter set "Normal": ResToGnd = 2200, ResToVcc = 2200, Vcc = 5  % base workspace
    parameter set "ResGND short": ResToGnd = 1e-9, ResToVcc = 2200, Vcc = 5  % base workspace
    parameter set "ResGND Open": ResToGnd = 1e9, ResToVcc = 2200, Vcc = 5  % base workspace
    parameter set "ResVcc Open": ResToGnd = 2200, ResToVcc = 1e9, Vcc = 5  % base workspace
    parameter set "ResVcc Short" (off): ResToGnd = 2200, ResToVcc = 1e-8, Vcc = 5  % base workspace
    pre-load callback:
      Vcc = 5;
      ResToGnd = 2200;
      ResToVcc = 2200;
    assessment "Assessment1": At any point of time, whenever InputVoltageFlag == uint8(1) is true then, with no delay, TF_Tank==single(0) must be true
      TF_Tank: signal test_TankSensing2_Harness5/test_TankSensing2|test_TankSensing2/hil_TankSensing_lib/hil_TankTfCalculation, port 1
      InputVoltageFlag: signal test_TankSensing2_Harness5/Test Sequence, port 3
    iterations:
      Iteration1: ParameterSet "Normal", TestSequenceScenario "Scenario_Normal"
      Iteration2: ParameterSet "Normal", TestSequenceScenario "InputVoltageFlag_Pulse"

  case "Input Voltage Flag on output" [baseline]
    model test_TankSensing2, harness test_TankSensing2_Harness5
    parameter set "Normal": ResToGnd = 22000, ResToVcc = 22000, Vcc = 5  % base workspace
    parameter set "ResGND short": ResToGnd = 1e-9, ResToVcc = 22000, Vcc = 5  % base workspace
    parameter set "ResGND Open": ResToGnd = 1e9, ResToVcc = 22000, Vcc = 5  % base workspace
    parameter set "ResVcc Open": ResToGnd = 22000, ResToVcc = 1e9, Vcc = 5  % base workspace
    parameter set "ResVcc Short" (off): ResToGnd = 22000, ResToVcc = 1e-8, Vcc = 5  % base workspace
    pre-load callback:
      Vcc = 5;
      ResToGnd = 22000;
      ResToVcc = 22000;
    assessment "Assessment1": At any point of time, whenever InputVoltageFlag == uint8(1)&TankSensingVoltage>=SensingThreshold& Polarity==uint8(0) & FaultMode ==uint8(0) is true then, with a delay of at most 0.01, TankLogicReal == uint8(1) must stay true for at least 0.01
    assessment "Assessment2": At any point of time, whenever InputVoltageFlag == uint8(1)&TankSensingVoltage>=SensingThreshold& Polarity==uint8(1)& FaultMode ==uint8(0) is true then, with a delay of at most 0.01, TankLogicReal == uint8(0) must stay true for at least 0.01
    assessment "Assessment3": At any point of time, whenever InputVoltageFlag == uint8(0)&TankSensingIn<=single(1)&TankSensingIn>=single(0)& Polarity==uint8(0)& FaultMode ==uint8(0) is true then, with a delay of at most 0.01, TankLogicReal == uint8(1) must stay true for at least 0.01
    assessment "Assessment4": At any point of time, whenever InputVoltageFlag == uint8(0)&TankSensingIn<=single(0)& Polarity==uint8(0)& FaultMode ==uint8(0) is true then, with a delay of at most 0.01, TankLogicReal == uint8(0) must stay true for at least 0.01
    assessment "Assessment5": At any point of time, whenever FaultMode == uint8(1) is true then, with a delay of at most 0.01, TankLogicReal == uint8(0) must stay true for at least 0.01
    assessment "Assessment6": At any point of time, whenever FaultMode == uint8(2) is true then, with a delay of at most 0.01, TankLogicReal == uint8(1) must stay true for at least 0.01
    assessment "Assessment7": At any point of time, whenever FaultMode == uint8(0) is true then, with a delay of at most 0.01, TankLogicReal ==TankLogicTheoric must stay true for at least 0.01
      TankLogicReal: signal test_TankSensing2_Harness5/Output Conversion Subsystem, port 1
      TankLogicTheoric: signal test_TankSensing2_Harness5/Output Conversion Subsystem, port 2
      TankSensingIn: signal test_TankSensing2_Harness5/Test Sequence, port 1
      TankSensingVoltage: signal test_TankSensing2_Harness5/Test Sequence, port 2
      InputVoltageFlag: signal test_TankSensing2_Harness5/Test Sequence, port 3
      Polarity: signal test_TankSensing2_Harness5/Test Sequence, port 4
      SensingThreshold: signal test_TankSensing2_Harness5/Test Sequence, port 5
      FaultMode: signal test_TankSensing2_Harness5/Test Sequence, port 6
    iterations:
      Iteration1: ParameterSet "Normal", TestSequenceScenario "Scenario_Normal"
      Iteration2: ParameterSet "Normal", TestSequenceScenario "InputVoltageFlag_one"
      Iteration3: ParameterSet "Normal", TestSequenceScenario "InputVoltageFlag_one_polarity_one"
      Iteration4: ParameterSet "Normal", TestSequenceScenario "TankSensingVoltage_more_5"
      Iteration5: ParameterSet "Normal", TestSequenceScenario "TankSensingVoltage_less_zero"
      Iteration6: ParameterSet "Normal", TestSequenceScenario "InputVoltageFlag_zero"
      Iteration7: ParameterSet "Normal", TestSequenceScenario "InputVoltageFlag_zero_more_1"
      Iteration8: ParameterSet "Normal", TestSequenceScenario "InputVoltageFlag_zero_less_0"
      Iteration9: ParameterSet "Normal", TestSequenceScenario "FaultMode_one"
      Iteration10: ParameterSet "Normal", TestSequenceScenario "FaultMode_two"
      Iteration11: ParameterSet "Normal", TestSequenceScenario "SensingThreshold_0_5"
      Iteration12: ParameterSet "Normal", TestSequenceScenario "SensingThreshold_2_5"